# Grasshopper definition 20230617_MS_branching by region subdivision - 2D.gh (Grasshopper 1.0.7)
# plug-ins: Human, Pufferfish

panel = Panel("Ignacio Ubaldini")
panel_2 = Panel("""Generativo
01_Area de trabajo""")

construct_point = ConstructPoint(XCoordinate="0", YCoordinate="0", ZCoordinate="0")

number_slider = Slider(5, range=0..100)
neg = Negative(Value=number_slider)
dom = ConstructDomain(DomainStart=neg, DomainEnd=number_slider)

# ---- group: 50
data = Data("75")

# ----
negative = Negative(Value="2500")
construct_domain = ConstructDomain(DomainStart=negative, DomainEnd="2500")
rectangle = Rectangle(Plane=PlaneXY(0, 0, 0), XSize=construct_domain, YSize=construct_domain, Radius=0)  # -> Rectangle, Length
divide_surface = DivideSurface(Surface=rectangle.Rectangle, UCount=data, VCount=data)  # -> Points, Normals, Parameters
flatten_tree = FlattenTree(Tree=divide_surface.Points, Path="{0}")

panel_3 = Panel("""01_01_Punto de origen

01_02_Boundary

01_03_Grilla inicial""")
number = Number("2500")
number_2 = Number("75")
data_2 = Data(construct_point)
data_3 = Data(rectangle.Rectangle)
data_4 = Data(flatten_tree)

# ----
# Generativo
# 02_Vector Field
# -----------------------------------------------
# 02_02_Generacion de elementos lineales
panel_4 = Panel("Ignacio Ubaldini")

panel_5 = Panel(panel_3)
number_3 = Number(number)
number_4 = Number(number_2)
data_5 = Data(data_2)
data_6 = Data(data_3)
data_7 = Data(data_4)

cantidad_de_puntos_del_populate = Panel("1")
scale = Slider(0.1, range=0.01..1)
number_slider_2 = Slider(61, range=0..100)

crv = Curve(rectangle.Rectangle)
area = Area(Geometry=crv)  # -> Area, Centroid
scale_2 = Scale(Geometry=crv, Center=area.Centroid, Factor=scale)  # -> Geometry, Transform
pop2d = Populate2D(Region=scale_2.Geometry, Count=cantidad_de_puntos_del_populate, Seed=number_slider_2)
cp = ClosestPoint(Point=pop2d, Cloud=flatten(data_7))  # -> ClosestPoint, CPIndex, Distance
disc = Discontinuity(Curve=crv, Level=1)  # -> Points, Parameters
rec_2pt = Rectangle2Pt(Plane=PlaneXY(0, 0, 0), PointA=cp.ClosestPoint, PointB=disc.Points, Radius=0)  # -> Rectangle, Length
jitter = Jitter(List=rec_2pt.Rectangle, Jitter=1, Seed=number_slider_2)  # -> Values, Indices
split = SplitList(List=jitter.Values, Index="2")  # -> ListA, flatten(ListB)

graft = GraftTree(Tree=split.ListA, IncludeEmptyLists=True, IncludeNullItems=True)
area_2 = Area(Geometry=graft)  # -> Area, Centroid
scale_3 = Scale(Geometry=graft, Center=area_2.Centroid, Factor=scale)  # -> Geometry, Transform
disc_2 = Discontinuity(Curve=graft, Level=1)  # -> Points, Parameters
pop2d_2 = Populate2D(Region=scale_3.Geometry, Count=cantidad_de_puntos_del_populate, Seed=number_slider_2)
cp_2 = ClosestPoint(Point=pop2d_2, Cloud=flatten(data_7))  # -> ClosestPoint, CPIndex, Distance
rec_2pt_2 = Rectangle2Pt(Plane=PlaneXY(0, 0, 0), PointA=cp_2.ClosestPoint, PointB=disc_2.Points, Radius=0)  # -> flatten(Rectangle), Length
jitter_2 = Jitter(List=rec_2pt_2.Rectangle, Jitter=1, Seed=number_slider_2)  # -> Values, Indices
split_2 = SplitList(List=jitter_2.Values, Index="2")  # -> ListA, flatten(ListB)

graft_2 = GraftTree(Tree=split_2.ListA, IncludeEmptyLists=True, IncludeNullItems=True)
area_3 = Area(Geometry=graft_2)  # -> Area, Centroid
scale_4 = Scale(Geometry=graft_2, Center=area_3.Centroid, Factor=scale)  # -> Geometry, Transform
pop2d_3 = Populate2D(Region=scale_4.Geometry, Count=cantidad_de_puntos_del_populate, Seed=number_slider_2)
disc_3 = Discontinuity(Curve=graft_2, Level=1)  # -> Points, Parameters
cp_3 = ClosestPoint(Point=pop2d_3, Cloud=flatten(data_7))  # -> ClosestPoint, CPIndex, Distance
rec_2pt_3 = Rectangle2Pt(Plane=PlaneXY(0, 0, 0), PointA=cp_3.ClosestPoint, PointB=disc_3.Points, Radius=0)  # -> flatten(Rectangle), Length

entwine = Entwine(Branch00=split.ListB, Branch01=split_2.ListB, Branch02=rec_2pt_3.Rectangle, FlattenInputs=True)

parcelas = Curve(entwine)

previewlw = CustomPreviewLineweights(
    Geometry=parcelas,
    Shader=ColourSwatch(SwatchColor=RGB(0, 0, 0)),
    Thickness=Slider(3, range=0..10),
    Absolute=invert(False))

number_5 = Number(number)
number_6 = Number(number_2)
data_8 = Data(data_2)
data_9 = Data(data_3)
data_10 = Data(data_4)

panel_7 = Panel("02_01_parcelas")
parcelas_2 = Curve(parcelas)

# ----
# Generativo
# 02_Vector Field
# -----------------------------------------------
# 02_02_Generacion de elementos lineales
panel_8 = Panel("Ignacio Ubaldini")

number_slider_3 = Slider(11.11, range=0..100)

flatten = FlattenTree(Tree=parcelas, Path="{0}")

number_slider_4 = Slider(0.25, range=0..1)
division = Division(A="40", B=2)
subtraction = Subtraction(A="1", B=number_slider_4)
addition = Addition(A="1", B=number_slider_4)
multiplication = Multiplication(A=division, B=addition)
multiplication_2 = Multiplication(A=division, B=subtraction)
divide = DivideCurve(Curve=rectangle.Rectangle, Count="40", Kinks=False)  # -> Points, Tangents, Parameters
dom_2 = ConstructDomain(DomainStart=multiplication_2, DomainEnd=multiplication)
random = Random(Range=dom_2, Number=1, Seed=number_slider_2, Integers=True)
random_2 = Random(Range="40", Number=1, Seed=number_slider_2, Integers=True)
addition_2 = Addition(A=random_2, B=random)
item = ListItem(List=divide.Points, Index=random_2, Wrap=True)
item_2 = ListItem(List=divide.Points, Index=addition_2, Wrap=True)
ln = Line(StartPoint=item, EndPoint=item_2)
crv_2 = Curve(flatten)
colom = CollisionOneMany(Collider=crv_2, Obstacles=ln)  # -> Collision, Index
dispatch = Dispatch(List=crv_2, DispatchPattern=colom.Collision)  # -> ListA, ListB
area_4 = Area(Geometry=dispatch.ListA)  # -> Area, Centroid
merge = Merge(Data1=area_4.Centroid, Data2=item, Data3=item_2)  # -> flatten(Result)
crv_cp = CurveClosestPoint(Point=merge, Curve=ln)  # -> Point, Parameter, Distance
sort = SortList(Keys=crv_cp.Parameter, ValuesA=merge)  # -> Keys, ValuesA
nurbs = NurbsCurve(Vertices=sort.ValuesA, Degree=3, Periodic=False)  # -> reparameterize(Curve), Length, Domain

area_5 = Area(Geometry=dispatch.ListB)  # -> Area, Centroid
side = CurveSide(Curve=nurbs.Curve, Point=area_5.Centroid)  # -> Side, Left, Right
dispatch_2 = Dispatch(List=area_5.Centroid, DispatchPattern=side.Left)  # -> ListA, ListB
entwine_2 = Entwine(Branch00=dispatch_2.ListA, Branch01=dispatch_2.ListB, FlattenInputs=True)
crv_cp_2 = CurveClosestPoint(Point=entwine_2, Curve=nurbs.Curve)  # -> Point, Parameter, Distance
sort_2 = SortList(Keys=crv_cp_2.Parameter, ValuesA=entwine_2)  # -> Keys, ValuesA
partition = PartitionList(List=sort_2.ValuesA, Size=Slider(3, range=0..10))
crv_cp_3 = CurveClosestPoint(Point=partition, Curve=nurbs.Curve)  # -> Point, Parameter, Distance
sort_3 = SortList(Keys=crv_cp_3.Distance, ValuesA=partition)  # -> Keys, ValuesA
item_3 = ListItem(List=sort_3.ValuesA, Index=0, Wrap=True)  # -> Item1, Item
crv_cp_4 = CurveClosestPoint(Point=item_3.Item1, Curve=data_3)  # -> Point, Parameter, Distance
crv_cp_5 = CurveClosestPoint(Point=item_3.Item, Curve=nurbs.Curve)  # -> Point, Parameter, Distance
addition_3 = Addition(A=crv_cp_5.Parameter, B=Slider(0.2, range=0..1))
min = Minimum(A=addition_3, B="1")
eval = EvaluateCurve(Curve=nurbs.Curve, Parameter=min)  # -> Point, Tangent, Angle
neg_2 = Negative(Value=eval.Tangent)
amp = Amplitude(Vector=neg_2, Amplitude=Slider(582, range=0..1000))
move = Move(Geometry=eval.Point, Motion=amp)  # -> Geometry, Transform
merge_2 = Merge(Data1=eval.Point, Data2=move.Geometry, Data3=sort_3.ValuesA, Data4=crv_cp_4.Point)
nurbs_2 = NurbsCurve(Vertices=merge_2, Degree=3, Periodic=False)  # -> simplify(Curve), Length, Domain

neg_3 = Negative(Value=number_slider_3)
pline = PolyLine(Vertices=sort.ValuesA, Closed=False)
pline_2 = PolyLine(Vertices=merge_2, Closed=False)
dom_3 = ConstructDomain(DomainStart=neg_3, DomainEnd=number_slider_3)
rectangle_2 = Rectangle(Plane=merge_2, XSize=dom_3, YSize=dom_3, Radius=0)  # -> Rectangle, Length
panel_9 = Panel("""25
25""")
merge_3 = Merge(Data1=pline_2, Data2=pline)
disc_4 = Discontinuity(Curve=rectangle_2.Rectangle, Level=1)  # -> Points, Parameters
Z = UnitZ(Factor="4")
move_2 = Move(Geometry=merge_3, Motion=Z)  # -> Geometry, Transform
item_4 = ListItem(List=disc_4.Points, Index=0, Wrap=True)  # -> Item, Item1, Item2, Item3
ln_2 = Line(StartPoint=item_4.Item, EndPoint=item_4.Item2)
explode = Explode(Curve=move_2.Geometry, Recursive=True)  # -> Segments, Vertices
ln_3 = Line(StartPoint=item_4.Item1, EndPoint=item_4.Item3)
dash = DashPattern(Curve=explode.Segments, Pattern=panel_9)  # -> Dashes, Gaps
number_slider_5 = Slider(4, range=0..100)
merge_4 = Merge(Data1=ln_2, Data2=ln_3)
swatch = ColourSwatch(SwatchColor=RGB(255, 0, 0))
previewlw_2 = CustomPreviewLineweights(Geometry=merge_4, Shader=swatch, Thickness=number_slider_5, Absolute=invert(False))
previewlw_3 = CustomPreviewLineweights(Geometry=dash.Dashes, Shader=swatch, Thickness=number_slider_5, Absolute=invert(False))

panel_10 = Panel("""03_01_Río principal

03_02_Ramificaciones""")
data_11 = Data(nurbs.Curve)
data_12 = Data(nurbs_2.Curve)

# ----
# Generativo
# 02_Vector Field
# -----------------------------------------------
# 02_03_Estado de carga
panel_11 = Panel("Ignacio Ubaldini")

data_13 = Data(parcelas)

panel_13 = Panel(panel_10)
data_14 = Data(data_11)
data_15 = Data(data_12)

dom_4 = ConstructDomain(DomainStart="1", DomainEnd="2")

# ----
# 01_01_Punto de origen
# 
# 01_02_Boundary
# 
# 01_03_Grilla inicial
number_7 = Number(number)
number_8 = Number(number_2)
data_16 = Data(data_2)
data_17 = Data(data_3)
data_18 = Data(data_4)

number_slider_6 = Slider(500, range=200..500)

end = EndPoints(Curve=data_15)  # -> Start, End
crv_cp_6 = CurveClosestPoint(Point=end.Start, Curve=data_14)  # -> flatten(Point), flatten(Parameter), Distance
sort_4 = SortList(Keys=crv_cp_6.Parameter, ValuesA=crv_cp_6.Point)  # -> Keys, ValuesA
shatter = Shatter(Curve=data_14, Parameters=sort_4.Keys)
midpt = CurveMiddle(Curve=shatter)
slideindom = SlideWithinDomain(Domain=dom_4, Factor=sort_4.Keys)
crv_cp_7 = CurveClosestPoint(Point=midpt, Curve=data_14)  # -> Point, Parameter, Distance
sort_5 = SortList(Keys=crv_cp_7.Parameter, ValuesA=shatter)  # -> Keys, ValuesA
len = Length(Curve=sort_5.ValuesA)
division_2 = Division(A=len, B=number_slider_6)
round = Round(Number=division_2)  # -> Nearest, Floor, Ceiling
divide_2 = DivideCurve(Curve=sort_5.ValuesA, Count=round.Ceiling, Kinks=False)  # -> Points, Tangents, Parameters

multiplication_3 = Multiplication(A=slideindom, B=".1")
crv_3 = Curve(data_15)
dom_5 = ConstructDomain(DomainStart=slideindom, DomainEnd=multiplication_3)  # -> graft(Domain)
len_2 = Length(Curve=crv_3)
division_3 = Division(A=len_2, B=number_slider_6)
round_2 = Round(Number=division_3)  # -> Nearest, Floor, Ceiling
divide_3 = DivideCurve(Curve=crv_3, Count=round_2.Ceiling, Kinks=False)  # -> Points, Tangents, Parameters

flatten_2 = FlattenTree(Tree=divide_2.Points, Path="{0}")
crv_4 = Curve(data_14)
number_slider_7 = Slider(15, range=0..50)
cset = CreateSet(List=flatten_2)  # -> Set, Map
crv_cp_8 = CurveClosestPoint(Point=cset.Set, Curve=crv_4)  # -> Point, Parameter, Distance
eval_2 = EvaluateCurve(Curve=crv_4, Parameter=crv_cp_8.Parameter)  # -> Point, Tangent, Angle
slideindom_2 = SlideWithinDomain(Domain=dom_4, Factor=crv_cp_8.Parameter)
multiplication_4 = Multiplication(A=number_slider_7, _125=1.25)
rotate = Rotate(Geometry=eval_2.Tangent, Angle=1.570796327, Plane=PlaneXY(0, 0, 0))  # -> Geometry, Transform
multiplication_5 = Multiplication(A=slideindom_2, B=multiplication_4)
number_slider_8 = Slider(35, range=0..100)
amp_2 = Amplitude(Vector=rotate.Geometry, Amplitude=multiplication_5)
neg_4 = Negative(Value=amp_2)
move_3 = Move(Geometry=eval_2.Point, Motion=neg_4)  # -> simplify(flatten(Geometry)), Transform
move_4 = Move(Geometry=eval_2.Point, Motion=amp_2)  # -> simplify(flatten(Geometry)), Transform
intcrv = Interpolate(Vertices=move_3.Geometry, Degree=3, Periodic=False, KnotStyle=1)  # -> Curve, Length, Domain
intcrv_2 = Interpolate(Vertices=move_4.Geometry, Degree=3, Periodic=False, KnotStyle=1)  # -> Curve, Length, Domain
number_slider_9 = Slider(0.25, range=0..1)
ext = ExtendCurve(Curve=intcrv.Curve, Type=0, Start="500", End="500")
ext_2 = ExtendCurve(Curve=intcrv_2.Curve, Type=0, Start="500", End="500")
dist = Distance(PointA=move_4.Geometry, PointB=move_3.Geometry)
trim = TrimWithRegion(Curve=ext, Region=data_3)  # -> Inside, Outside
trim_2 = TrimWithRegion(Curve=ext_2, Region=data_3)  # -> Inside, Outside
multiplication_6 = Multiplication(A=dist, B=number_slider_9)
flip = FlipCurve(Curve=trim.Inside)  # -> Curve, Flag
amp_3 = Amplitude(Vector=eval_2.Tangent, Amplitude=multiplication_6)
neg_5 = Negative(Value=amp_3)
move_5 = Move(Geometry=eval_2.Point, Motion=neg_5)  # -> Geometry, Transform
merge_5 = Merge(Data1=trim_2.Inside, Data2=flip.Curve)
arc = Arc3Pt(PointA=move_4.Geometry, PointB=move_5.Geometry, PointC=move_3.Geometry)  # -> Arc, Plane, Radius
connect = ConnectCurves(Curves=merge_5, Continuity=0, Close=True, Bulge=1)
cull_i = CullIndex(List=arc.Arc, Indices="-1", Wrap=True)

rotate_2 = Rotate(Geometry=divide_3.Tangents, Angle=1.570796327, Plane=PlaneXY(0, 0, 0))  # -> Geometry, Transform
range = Range(Domain=dom_5, Steps=round_2.Ceiling)
multiplication_7 = Multiplication(A=range, B=number_slider_7)
amp_4 = Amplitude(Vector=rotate_2.Geometry, Amplitude=multiplication_7)
move_6 = Move(Geometry=divide_3.Points, Motion=amp_4)  # -> simplify(Geometry), Transform
neg_6 = Negative(Value=amp_4)
move_7 = Move(Geometry=divide_3.Points, Motion=neg_6)  # -> simplify(Geometry), Transform
dist_2 = Distance(PointA=move_6.Geometry, PointB=move_7.Geometry)
multiplication_8 = Multiplication(A=dist_2, B=number_slider_9)
intcrv_3 = Interpolate(Vertices=move_7.Geometry, Degree=3, Periodic=False, KnotStyle=1)  # -> Curve, Length, Domain
intcrv_4 = Interpolate(Vertices=move_6.Geometry, Degree=3, Periodic=False, KnotStyle=1)  # -> Curve, Length, Domain
amp_5 = Amplitude(Vector=divide_3.Tangents, Amplitude=multiplication_8)
move_8 = Move(Geometry=divide_3.Points, Motion=amp_5)  # -> Geometry, Transform
ext_3 = ExtendCurve(Curve=intcrv_3.Curve, Type=0, Start="0", End="500")
ext_4 = ExtendCurve(Curve=intcrv_4.Curve, Type=0, Start="0", End="500")
trim_3 = TrimWithRegion(Curve=ext_3, Region=data_3)  # -> Inside, Outside
trim_4 = TrimWithRegion(Curve=ext_4, Region=data_3)  # -> Inside, Outside
arc_2 = Arc3Pt(PointA=move_6.Geometry, PointB=move_8.Geometry, PointC=move_7.Geometry)  # -> Arc, Plane, Radius
flip_2 = FlipCurve(Curve=trim_3.Inside)  # -> Curve, Flag
merge_6 = Merge(Data1=trim_4.Inside, Data2=flip_2.Curve)
cull_i_2 = CullIndex(List=arc_2.Arc, Indices="0", Wrap=True)
connect_2 = ConnectCurves(Curves=merge_6, Continuity=0, Close=True, Bulge=1)

merge_7 = Merge(Data1=connect, Data2=connect_2)  # -> flatten(Result)
runion = RegionUnion(Curves=merge_7)
preview = CustomPreview(Geometry=runion, Material=ColourSwatch(SwatchColor=RGB(0, 4, 255)))

# ----
# GRILLA
unit_z = UnitZ(Factor=-10)
point = Point(flatten_tree)
move_9 = Move(Geometry=point, Motion=unit_z)  # -> Geometry, Transform

rectangle_3 = Rectangle(Plane=move_9.Geometry, XSize=dom, YSize=dom, Radius=0)  # -> Rectangle, Length
rotate_3 = Rotate(Geometry=rectangle_3.Rectangle, Angle=degrees("45"), Plane=move_9.Geometry)  # -> Geometry, Transform
disc_5 = Discontinuity(Curve=rotate_3.Geometry, Level=1)  # -> Points, Parameters
item_5 = ListItem(List=disc_5.Points, Index=0, Wrap=True)  # -> Item, Item1, Item2, Item3
ln_4 = Line(StartPoint=item_5.Item, EndPoint=item_5.Item2)
ln_5 = Line(StartPoint=item_5.Item1, EndPoint=item_5.Item3)
merge_8 = Merge(Data1=ln_4, Data2=ln_5)

custom_preview_lineweights = CustomPreviewLineweights(
    Geometry=merge_8,
    Shader=ColourSwatch(SwatchColor=RGB(128, 128, 128)),
    Thickness=Slider(2, range=0..10),
    Absolute=invert(False))
